# Grasshopper definition LSysBreak.gh (Grasshopper 1.0.7)
# plug-ins: UrbanDesignEngine

radians = Radians(Degrees=Slider(84, range=0..100))
radians_2 = Radians(Degrees=Slider(91, range=0..100))
number_slider = Slider(45, range=0..100)
lsystem = LSystem(
    Iterations=Slider(30, range=0..100),
    MinDistance=Slider(5, range=0..10),
    MaxDistance=Slider(12, range=0..100),
    SnapDistance=Slider(4, range=0..10),
    MinimumAngle=radians,
    MaximumAngle=radians_2,
    NumGenAttempt=Slider(52, range=0..100),
    Seed=Slider(0, range=0..10))  # -> Lines, Faces
