# Grasshopper definition LSystemTopologyTest.gh (Grasshopper 1.0.7)
# plug-ins: UrbanDesignEngine

geometry = Geometry(<point referenced from the Rhino model>)
geometry_2 = Geometry(<point referenced from the Rhino model>)
radians = Radians(Degrees=Slider(86, range=0..100))
radians_2 = Radians(Degrees=Slider(94, range=0..100))
geometry_3 = Geometry([<curve referenced from the Rhino model> x2])
lsystem = LSystem(
    Iterations=Slider(5, range=0..100),
    MinDistance=Slider(8, range=0..10),
    MaxDistance=Slider(32, range=0..100),
    SnapDistance=Slider(6, range=0..10),
    MinimumAngle=radians,
    MaximumAngle=radians_2,
    NumGenAttempt=Slider(9, range=0..10),
    NumPossibleGrowths=Slider(2, range=0..10),
    Seed=Slider(3, range=0..10))  # -> Lines, Faces
snapdemocomponent = SnapDemoComponent(Source=geometry_2, IntendedTarget=geometry, Obstacles=geometry_3, R=Slider(6, range=0..10))  # -> HasSnapEvent, Distance, Point, LineId
join_curves = JoinCurves(Curves=lsystem.Lines, Preserve=False)
graphfromcurvenetwork = GraphFromCurveNetwork(Curves=lsystem.Lines)  # -> UDEGraph, GraphEdges, GraphNodes, GraphPlanarFaces
dualgraph = DualGraph(UDEGraph=graphfromcurvenetwork.UDEGraph)
accessgraphcontent = AccessGraphContent(UDEGraph=dualgraph)  # -> Nodes, Edges, EdgeCurves, Faces, FaceCurves, NodeAdjacentNode, NodeAdjacentEdge, NodeAdjacentFace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
