# Grasshopper definition Line Division Test.gh (Grasshopper 1.0.7)

geometry = Geometry(<curve referenced from the Rhino model>)
geometry_2 = Geometry(<curve referenced from the Rhino model>)
geometry_3 = Geometry(<curve referenced from the Rhino model>)
geometry_4 = Geometry(<curve referenced from the Rhino model>)
c_script = CSharpScript(x=geometry_2, y=geometry_4, z=geometry_3)  # -> out, A, B, C; inputs x: Polyline, y: Line, z: Line
# ---------- c_script: C# usings ----------
using System.Linq;
using Rhino.Geometry.Intersect;

public static class GlobalSettings
{
  public static double AbsoluteTolerance = 0.0001;
  public static string SCPrefix = "UDE";
  public static double DefaultOffsetDitance = 4.0;
  public static double DefaultOffsetExtensionDistance = 300;
}

public static class TestFuncs
{
  public static int OnSegmentId(Point3d pt, Polyline pl)
  {
    var PlotsBoundarySegments = pl.GetSegments();
    for (int i = 0; i < PlotsBoundarySegments.Count(); i++)
    {
      if (PlotsBoundarySegments[i].DistanceTo(pt, true) < GlobalSettings.AbsoluteTolerance) return i;
    }
    return -1;
  }

  public static bool Intersection2Divide(Polyline BoundaryLine, Line lineA, Line lineB, out Polyline tb1, out Polyline tb2, out List<Line> dv)
  {
    tb1 = null;
    tb2 = null;
    dv = new List<Line>();
    double a;
    double b;
    bool result = Intersection.LineLine(lineA, lineB, out a, out b, GlobalSettings.AbsoluteTolerance, true);
    if (!result)
    {
      return false;
    }
    dv = new List<Line>() { new Line(lineA.From, lineA.PointAt(a)), new Line(lineA.PointAt(a), lineB.From) };
    int fromId = OnSegmentId(BoundaryLine.ClosestPoint(lineA.From), BoundaryLine);
    int toId = OnSegmentId(BoundaryLine.ClosestPoint(lineB.From), BoundaryLine);
    List<Point3d> ptsA = new List<Point3d>();
    List<Point3d> ptsB = new List<Point3d>();


    for (int i = 0; i < BoundaryLine.Count; i++)
    {
      if (i < (fromId < toId ? fromId : toId))
      {
        ptsA.Add(BoundaryLine[i]);
      }
      else if (i == (fromId < toId ? fromId : toId))
      {
        ptsA.Add(BoundaryLine[i]);
        ptsA.Add(BoundaryLine.ClosestPoint(fromId < toId ? lineA.From : lineB.From));
        ptsA.Add(lineA.PointAt(a));
        ptsA.Add(BoundaryLine.ClosestPoint(fromId < toId ? lineB.From : lineA.From));

        ptsB.Add(BoundaryLine.ClosestPoint(fromId < toId ? lineB.From : lineA.From));
        ptsB.Add(lineA.PointAt(a));
        ptsB.Add(BoundaryLine.ClosestPoint(fromId < toId ? lineA.From : lineB.From));
      }
      else if (i < (fromId < toId ? toId : fromId))
      {
        ptsB.Add(BoundaryLine[i]);
      }
      else if (i == (fromId < toId ? toId : fromId))
      {
        ptsB.Add(BoundaryLine[i]);
        ptsB.Add(BoundaryLine.ClosestPoint(fromId < toId ? lineB.From : lineA.From));
      }
      else
      {
        ptsA.Add(BoundaryLine[i]);
      }
    }

    tb1 = new Polyline(ptsA);
    tb2 = new Polyline(ptsB);
    return true;
  }

  public static void Intersection1Divide(Line line, Polyline BoundaryLine, out Polyline tb1, out Polyline tb2)
  {
    tb1 = null;
    tb2 = null;


    int fromId = OnSegmentId(BoundaryLine.ClosestPoint(line.From), BoundaryLine);
    int toId = OnSegmentId(BoundaryLine.ClosestPoint(line.To), BoundaryLine);
    List<Point3d> ptsA = new List<Point3d>();
    List<Point3d> ptsB = new List<Point3d>();
    if (fromId > toId)
    {
      int tii = fromId;
      fromId = toId;
      toId = tii;
      line.Flip();
    }


    for (int i = 0; i < BoundaryLine.Count; i++)
    {
      if (i < (fromId < toId ? fromId : toId))
      {
        ptsA.Add(BoundaryLine[i]);
      } else if (i == (fromId < toId ? fromId : toId))
      {
        ptsA.Add(BoundaryLine[i]);
        ptsA.Add(BoundaryLine.ClosestPoint(fromId < toId ? line.From : line.To));
        ptsA.Add(BoundaryLine.ClosestPoint(fromId < toId ? line.To : line.From));

        ptsB.Add(BoundaryLine.ClosestPoint(fromId < toId ? line.To : line.From));
        ptsB.Add(BoundaryLine.ClosestPoint(fromId < toId ? line.From : line.To));
      } else if (i < (fromId < toId ? toId : fromId))
      {
        ptsB.Add(BoundaryLine[i]);
      } else if (i == (fromId < toId ? toId : fromId))
      {
        ptsB.Add(BoundaryLine[i]);
        ptsB.Add(BoundaryLine.ClosestPoint(fromId < toId ? line.To : line.From));
      } else
      {
        ptsA.Add(BoundaryLine[i]);
      }
    }

    tb1 = new Polyline(ptsA);
    tb2 = new Polyline(ptsB);
  }

}
# ---------- c_script: C# ----------
    Polyline a;
    Polyline b;
    List<Line> c;
    TestFuncs.Intersection2Divide(x, y, z, out a, out b, out c);
    //TestFuncs.Intersection1Divide(y, x, out a, out b);
    A = a;
    B = b;
    //C = c;
# ---------- c_script: C# additional code ----------
  /// <summary>
  /// This method will be called once every solution, before any calls to RunScript.
  /// </summary>
  public override void BeforeRunScript()
  { }
  /// <summary>
  /// This method will be called once every solution, after any calls to RunScript.
  /// </summary>
  public override void AfterRunScript()
  { }
# ---------- end c_script ----------
geometry_5 = Geometry(c_script.B)
geometry_6 = Geometry(c_script.A)
