# Grasshopper definition NetworkCurveIntersectionTest.gh (Grasshopper 1.0.7)

number_slider = Slider(3, range=0..10)
geometry = Geometry([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])
c_script = CSharpScript(crvs=geometry, i=number_slider)  # -> out, A; inputs crvs: list of Curve, i: Int32
# ---------- c_script: C# usings ----------
using Rhino.Geometry.Intersect;
using System.Linq;
# ---------- c_script: C# ----------
    var nci = new NetworkCurvesIntersection(crvs);
    A = nci.GetCurveParameters(i);
# ---------- c_script: C# additional code ----------
  public class NetworkCurvesIntersection
  {
    public List<Curve> Curves;
    List<CurveDelegate> delegates = new List<CurveDelegate>();

    public List<double> GetCurveParameters(int index)
    {
      CurveDelegate cd = delegates[index];
      return cd.SortedIntersectionParameters;
    }


    public NetworkCurvesIntersection(List<Curve> curves)
    {
      Curves = curves;
      Curves.ForEach(c => delegates.Add(new CurveDelegate(c)));
      int count = curves.Count;
      double tolerance = RhinoDoc.ActiveDoc.ModelAbsoluteTolerance;
      for (int i = 0; i < count; i++)
      {
        for (int j = i; j < count; j++)
        {
          if (i != j)
          {
            CurveIntersections intersectionEvents = Intersection.CurveCurve(Curves[i], Curves[j], tolerance, tolerance);
            foreach (IntersectionEvent e in intersectionEvents)
            {
              if (e.IsPoint)
              {
                delegates[i].AddParameter(e.ParameterA);
                delegates[j].AddParameter(e.ParameterB);
              } else if (e.IsOverlap)
              {
                delegates[i].AddParameter(e.OverlapA.Min);
                delegates[i].AddParameter(e.OverlapA.Max);
                delegates[j].AddParameter(e.OverlapB.Min);
                delegates[j].AddParameter(e.OverlapB.Max);
              }
            }
          }
        }
      }

    }

    internal class CurveDelegate
    {
      public Curve curve;
      List<double> IntersectionParameters = new List<double>();
      public List<double> SortedIntersectionParameters
      {
        get
        {
          List<double> ps = IntersectionParameters.Distinct().ToList();
          ps.Sort();
          return ps;
        }
      }

      public CurveDelegate(Curve curve)
      {
        IntersectionParameters.Add(curve.Domain.Min);
        IntersectionParameters.Add(curve.Domain.Max);
      }

      public void AddParameter(double p)
      {
        IntersectionParameters.Insert(IntersectionParameters.Count - 2, p);
      }

      public void AddParameters(List<double> pp)
      {
        IntersectionParameters.InsertRange(IntersectionParameters.Count - 2, pp);
      }
    }
  }
# ---------- end c_script ----------
list_item = ListItem(List=geometry, Index=number_slider, Wrap=True)
evaluate_curve = EvaluateCurve(Curve=list_item, Parameter=c_script.A)  # -> Point, Tangent, Angle
