# Grasshopper definition SnapDemo.gh (Grasshopper 1.0.7)
# plug-ins: UrbanDesignEngine

geometry = Geometry(<point referenced from the Rhino model>)
geometry_2 = Geometry(<point referenced from the Rhino model>)
number_slider = Slider(4, range=0..10)
geometry_3 = Geometry([<curve referenced from the Rhino model> x14])
number_slider_2 = Slider(12, range=0..100)
vector_2pt = Vector2Pt(PointA=geometry, PointB=geometry_2, Unitize=True)  # -> Vector, Length
multiplication = Multiplication(A=number_slider_2, B=vector_2pt.Vector)
addition = Addition(A=geometry_2, B=multiplication)
line = Line(StartPoint=geometry, EndPoint=addition)
negative = Negative(Value=number_slider_2)
number = Number(number_slider_2)
offset_curve = OffsetCurve(Curve=line, Distance=number_slider_2, Plane=PlaneXY(0, 0, 0), Corners=1)
offset_curve_2 = OffsetCurve(Curve=line, Distance=negative, Plane=PlaneXY(0, 0, 0), Corners=1)
snapdemocomponent = SnapDemoComponent(Source=geometry, IntendedTarget=geometry_2, Obstacles=geometry_3, R=number)  # -> HasSnapEvent, Distance, Point, LineId
panel = Panel(snapdemocomponent.LineId)
geometry_4 = Geometry(snapdemocomponent.Point)
panel_2 = Panel(snapdemocomponent.HasSnapEvent)
panel_3 = Panel(snapdemocomponent.Distance)
