# Grasshopper definition SnapLine.gh (Grasshopper 1.0.7)

geometry = Geometry(Point(-4.637074828, 13.82317149, 0))
number_slider = Slider(3, range=0..10)
geometry_2 = Geometry([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])
geometry_3 = Geometry(Point(1.49627703, 7.72514357, 0))
point = Point(Point(0, 0, 0))
point_2 = Point(geometry)
vector_2pt = Vector2Pt(PointA=point, PointB=point_2, Unitize=False)  # -> Vector, Length
geometry_4 = Geometry(Point(20.32675377, 7.553801005, 0))
geometry_5 = Geometry(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)
c_script = CSharpScript(x=geometry_5, y=geometry_4)  # -> out, A; inputs x: Line, y: Point3d
# ---------- c_script: C# usings ----------
public static class MathsHelper
{


  public static Func<Point3d, int> PointLineRelation(Line line)
  {
    var lineEquation = LineEquation(line);
    if (double.IsNaN(lineEquation.Invoke(0)) || double.IsInfinity(lineEquation.Invoke(0)))
    {
      return p => (p.X > line.From.X) ? 1 : (p.X == line.From.X) ? 0 : -1;
    } else
    {
      return p => (p.Y > lineEquation.Invoke(p.X)) ? 1 : ((p.Y == lineEquation.Invoke(p.X)) ? 0 : -1);
    }
  }

  public static Func<double, double> LineEquation(Line line)
  {
    double dy = line.To.Y - line.From.Y;
    double dx = line.To.X - line.From.X;
    if (dx == 0)
    {
      return x => (x == line.From.X) ? double.PositiveInfinity : double.NaN;
    } else
    {
      return x => (x - line.From.X) * dy / dx + line.From.Y;
    }
  }
}
# ---------- c_script: C# ----------
    var rel = MathsHelper.PointLineRelation(x);
    A = rel.Invoke(y);
# ---------- end c_script ----------
amplitude = Amplitude(Vector=vector_2pt.Vector, Amplitude=Slider(1, range=0..1))
c_script_2 = CSharpScript(x=point, y=point_2, z=geometry_2, u=geometry_3, r=number_slider)  # -> out, A, B, C, D; inputs x: Point3d, y: Point3d, z: list of Line, u: Point3d, r: Double
# ---------- c_script_2: C# usings ----------
using Rhino.Geometry.Intersect;
using System.Linq;

public class GlobalSettings
{
  public static double AbsoluteTolerance = 0.0001;
}


public class Snap
{
  public double R = 1.0;
  public double LocalRadiusFactor = 10.0; // the radius of the "local" region / R
  public Point3d Source;
  public Point3d IntendedTarget;
  public List<Line> Obstacles;

  public Predicate<Point3d> Test1_PointInRoughProximity;

  //public Predicate<Line> Test2_SegmentIntersectingProximity;

  public Predicate<Point3d> Test3_PointInLocalRegion;

  Func<Point3d, int> func0;
  Func<Point3d, int> funcA;
  Func<Point3d, int> funcB;
  Func<Point3d, int> funcC;
  Func<Point3d, int> funcD;
  Func<Point3d, int> funcM;

  //    A    L    B
  //    |    |    |
  // D----------------D
  //    | /  |  \R|
  //    |/   |   \|
  // M----------------M
  //    |    |    |
  //    |    |    |
  //    |    |    |
  //    |    |    |
  // C-------O--------C
  //    |    |    |
  //    A    L    B

  Func<Point3d, int> funcLocalLB;
  Func<Point3d, int> funcLocalRB;
  Func<Point3d, int> funcLocalUB;
  Func<Point3d, int> funcLocalBB;

  Line lineExtended;

  /// <summary>
  /// WARNING: PLEASE IGNORE ADJACENT NODES WHEN REQUIRED!
  /// </summary>
  /// <param name="source"></param>
  /// <param name="intendedTarget"></param>
  /// <param name="obstacles"></param>
  public Snap(Point3d source, Point3d intendedTarget, List<Line> obstacles, double r)
  {
    Source = source;
    IntendedTarget = intendedTarget;
    Obstacles = obstacles;
    R = r;

    Vector3d vec = new Vector3d(intendedTarget - source);
    vec.Unitize();
    Vector3d vecRo = new Vector3d(vec);
    vecRo.Rotate(Math.PI / 2.0, Vector3d.ZAxis);

    Line line = new Line(
      source,
      intendedTarget
      );
    func0 = MathsHelper.PointLineRelation(line);

    lineExtended = new Line(
      source,
      intendedTarget + vec * R
      );

    Line lineA = new Line(
      source + vecRo * R,
      intendedTarget + vec * R + vecRo * R
      );
    funcA = MathsHelper.PointLineRelation(lineA);

    Line lineB = new Line(
      source - vecRo * R,
      intendedTarget + vec * R - vecRo * R
      );
    funcB = MathsHelper.PointLineRelation(lineB);

    Line lineC = new Line(
      source + vecRo * R,
      source - vecRo * R
      );
    funcC = MathsHelper.PointLineRelation(lineC);

    Line lineD = new Line(
      intendedTarget + vec * R + vecRo * R,
      intendedTarget + vec * R - vecRo * R
      );
    funcD = MathsHelper.PointLineRelation(lineD);

    Line lineM = new Line(
      intendedTarget + vecRo * R,
      intendedTarget - vecRo * R
      );
    funcM = MathsHelper.PointLineRelation(lineM);


    Line localLeftBound = new Line(
      intendedTarget - Vector3d.XAxis * LocalRadiusFactor * R + Vector3d.YAxis * LocalRadiusFactor * R,
      intendedTarget - Vector3d.XAxis * LocalRadiusFactor * R - Vector3d.YAxis * LocalRadiusFactor * R
      );
    funcLocalLB = MathsHelper.PointLineRelation(localLeftBound);

    Line localRightBound = new Line(
      intendedTarget + Vector3d.XAxis * LocalRadiusFactor * R - Vector3d.YAxis * LocalRadiusFactor * R,
      intendedTarget + Vector3d.XAxis * LocalRadiusFactor * R + Vector3d.YAxis * LocalRadiusFactor * R
      );
    funcLocalRB = MathsHelper.PointLineRelation(localRightBound);

    Line localUpperBound = new Line(
      intendedTarget + Vector3d.XAxis * LocalRadiusFactor * R + Vector3d.YAxis * LocalRadiusFactor * R,
      intendedTarget - Vector3d.XAxis * LocalRadiusFactor * R + Vector3d.YAxis * LocalRadiusFactor * R
      );
    funcLocalUB = MathsHelper.PointLineRelation(localUpperBound);

    Line localBottomBound = new Line(
      intendedTarget - Vector3d.XAxis * LocalRadiusFactor * R - Vector3d.YAxis * LocalRadiusFactor * R,
      intendedTarget + Vector3d.XAxis * LocalRadiusFactor * R - Vector3d.YAxis * LocalRadiusFactor * R
      );
    funcLocalBB = MathsHelper.PointLineRelation(localBottomBound);

    Test1_PointInRoughProximity = p =>
      {
      return
        funcA.Invoke(p) * funcB.Invoke(p) == -1 && // different sides of A and B
        funcC.Invoke(p) * funcD.Invoke(p) == -1;   // different sides of C and D
      };

    Test3_PointInLocalRegion = p =>
      {
      return
        funcLocalLB.Invoke(p) * funcLocalRB.Invoke(p) == -1 &&
        funcLocalUB.Invoke(p) * funcLocalBB.Invoke(p) == -1;
      };

  }

  public bool Solve(out double distance, out Point3d point, out int lineIndex)
  {
    List<double> dists = new List<double>();
    List<Point3d> pts = new List<Point3d>();
    List<int> lineIndices = new List<int>();

    for (int i = 0; i < Obstacles.Count; i++)
    {
      Line line = Obstacles[i];
      double dist = -1;
      double distTemp;
      Point3d pt = Point3d.Origin;
      Point3d ptTemp;
      bool performTest3 = true;
      bool snapPtFound = false;
      if (Test1(line.From, out distTemp))
      {
        pt = line.From;
        dist = distTemp;
        performTest3 = false;
        snapPtFound = true;
      }
      if (Test1(line.To, out distTemp))
      {
        if (dist == -1 || (distTemp < dist && distTemp >= 0))
        {
          dist = distTemp;
          pt = line.To;
          performTest3 = false;
          snapPtFound = true;
        }
      }
      if (Test2(line, out distTemp, out ptTemp))
      {
        if (distTemp < dist && distTemp >= 0)
        {
          dist = distTemp;
          pt = line.To;
          performTest3 = false;

        }
      }
      if (performTest3)
      {
        if (Test3(line, out distTemp, out ptTemp))
        {
          dist = distTemp;
          pt = ptTemp;
          snapPtFound = true;
        }
      }

      if (snapPtFound)
      {
        dists.Add(dist);
        pts.Add(pt);
        lineIndices.Add(i);
      }

    }

    if (dists.Count > 0)
    {
      int argMin = dists.IndexOf(dists.Min());
      distance = dists[argMin];
      point = pts[argMin];
      lineIndex = lineIndices[argMin];
      return true;
    } else
    {
      distance = -1;
      point = Point3d.Origin;
      lineIndex = -1;
      return false;
    }
  }



  /// <summary>
  /// Determine if there are points inside the proximity zone
  /// </summary>
  /// <param name="testPt">Test point</param>
  /// <returns>true if test point is inside the proximity zone</returns>
  bool Test1(Point3d testPt, out double distance)
  {
    distance = -1;
    if (Test1_PointInRoughProximity.Invoke(testPt))
    {
      if (funcC.Invoke(testPt) * funcM.Invoke(testPt) == -1) // not in the semicircle
      {
        distance = testPt.DistanceTo(Source);
        return true;
      } else
      {
        distance = testPt.DistanceTo(Source);
        return testPt.DistanceTo(IntendedTarget) <= R;
      }
    } else
    {
      return false;
    }
  }

  /// <summary>
  /// Determine if there are line segments traversing the proximity zone
  /// </summary>
  bool Test2(Line line, out double distance, out Point3d point)
  {
    distance = -1;
    point = Point3d.Origin;
    if (func0.Invoke(line.From) * func0.Invoke(line.To) == -1) // different sides of line(0)
    {
      double a;
      double b;
      if (Intersection.LineLine(lineExtended, line, out a, out b, GlobalSettings.AbsoluteTolerance, true))
      {
        distance = lineExtended.PointAt(a).DistanceTo(Source);
        point = lineExtended.PointAt(a);
        return true;
      }
      else
      {
        // disjoint
        distance = lineExtended.PointAt(a).DistanceTo(line.PointAt(b));
        point = line.PointAt(b);
        return distance <= R;
      }
    }
    else
    {
      return false;
    }

  }

  /// <summary>
  /// Determine if the intended target point is sufficiently away from proximate segments
  /// </summary>
  bool Test3(Line line, out double distance, out Point3d point)
  {
    distance = -1;
    point = Point3d.Origin;

    if (Test3_PointInLocalRegion.Invoke(line.From) || Test3_PointInLocalRegion.Invoke(line.To))
    {
      distance = line.ClosestPoint(IntendedTarget, true).DistanceTo(IntendedTarget);
      point = line.ClosestPoint(IntendedTarget, true);
      return distance < R;
    } else
    {
      return false;
    }
  }
}

public static class MathsHelper
{


  public static Func<Point3d, int> PointLineRelation(Line line)
  {
    var lineEquation = LineEquation(line);
    if (double.IsNaN(lineEquation.Invoke(0)) || double.IsInfinity(lineEquation.Invoke(0)))
    {
      return p => (p.X > line.From.X) ? 1 : (p.X == line.From.X) ? 0 : -1;
    } else
    {
      return p => (p.Y > lineEquation.Invoke(p.X)) ? 1 : (p.Y == lineEquation.Invoke(p.X)) ? 0 : -1;
    }
  }

  public static Func<double, double> LineEquation(Line line)
  {
    double dy = line.To.Y - line.From.Y;
    double dx = line.To.X - line.From.X;
    if (dx == 0)
    {
      return x => (x == line.From.X) ? double.PositiveInfinity : double.NaN;
    } else
    {
      return x => (x - line.From.X) * dy / dx + line.From.Y;
    }
  }
}
# ---------- c_script_2: C# ----------
    Snap snap = new Snap(x, y, z, r);
    double distance;
    Point3d pt;
    int i;
    A = snap.Solve(out distance, out pt, out i);
    B = distance;
    C = pt;
    D = i;
# ---------- end c_script_2 ----------
panel = Panel(c_script.A)
multiplication = Multiplication(A=amplitude, B=number_slider)
panel_2 = Panel(c_script_2.B)
panel_3 = Panel(c_script_2.A)
list_item = ListItem(List=geometry_2, Index=c_script_2.D, Wrap=False)
geometry_6 = Geometry(c_script_2.C)
move = Move(Geometry=point_2, Motion=multiplication)  # -> Geometry, Transform
geometry_7 = Geometry(list_item)
line = Line(StartPoint=point, EndPoint=move.Geometry)
geometry_8 = Geometry(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)
geometry_9 = Geometry(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)
negative = Negative(Value=number_slider)
c_script_3 = CSharpScript(x=geometry_8, y=geometry_9)  # -> out, A, B, C; inputs x: Line, y: Line
# ---------- c_script_3: C# usings ----------
using Rhino.Geometry.Intersect;
# ---------- c_script_3: C# ----------
    double a;
    double b;
    A = Intersection.LineLine(x, y, out a, out b, RhinoDoc.ActiveDoc.ModelAbsoluteTolerance, true);
    B = a;
    C = b;
# ---------- end c_script_3 ----------
evaluate_curve = EvaluateCurve(Curve=geometry_9, Parameter=c_script_3.C)  # -> Point, Tangent, Angle
offset_curve = OffsetCurve(Curve=line, Distance=negative, Plane=PlaneXY(0, 0, 0), Corners=1)
offset_curve_2 = OffsetCurve(Curve=line, Distance=number_slider, Plane=PlaneXY(0, 0, 0), Corners=1)
panel_4 = Panel(c_script_3.A)
panel_5 = Panel(c_script_3.C)
panel_6 = Panel(c_script_3.B)
end_points = EndPoints(Curve=offset_curve_2)  # -> Start, End
end_points_2 = EndPoints(Curve=offset_curve)  # -> Start, End
line_2 = Line(StartPoint=end_points.End, EndPoint=end_points_2.End)
line_3 = Line(StartPoint=end_points.Start, EndPoint=end_points_2.Start)
