# Grasshopper definition parcelise.gh (Grasshopper 1.0.7)

c_script = CSharpScript()  # -> out, A; inputs x: Polyline
# ---------- c_script: C# usings ----------
using System.Linq;
using Rhino.Geometry.Intersect;

public class TessellationTest
{
  public Polyline BoundaryLine;
  public List<double> PrincipleAngles;
  public List<double> PrincipleWeights;
  public List<TessellationTest> Divisions;

  public bool Finalised
  {
    get
    {
      if (AreaMassProperties.Compute(BoundaryLine.ToNurbsCurve()).Area < 64)
      {
        return false;
      }
      double minDist = 8;
      for (int i = 0; i < BoundaryLine.Count - 1; i++)
      {
        for (int j = i; j < BoundaryLine.Count - 1; j++)
        {
          if (i != j)
          {
            if (BoundaryLine[i].DistanceTo(BoundaryLine[j]) < minDist)
            {
              return false;
            }
          }

        }
      }
      return true;
    }
  }

  public TessellationTest(Polyline pl)
  {
    BoundaryLine = pl;
    GeometryHelper.LinesPrincipleDirections(pl.GetSegments().ToList(), out PrincipleAngles, out PrincipleWeights);


  }

  public enum SolutionStat
  {
    finished = 0,
    failed = 1,
    continu = 2,
  }

  public SolutionStat Solve()
  {
    if (Finalised)
    {
      Divisions.Add(this);
      return SolutionStat.finished;
    }
    int maxIterations = 10;
    int iterations = 0;
    Random random = new Random();
    while (iterations < maxIterations)
    {
      double p = random.NextDouble() * ProjectedLengthSum;
      Vector3d direction = IncisionDirection(p);
      double maxD = IncisionLineMaxLength(p, direction);
      if (maxD <= 30)
      {
        TessellationTest tt1;
        TessellationTest tt2;
        Intersection1Divide(IncisionLine(p, direction, maxD), out tt1, out tt2);
        if (tt1.Solve() == SolutionStat.finished)
        {
          return tt2.Solve();
        } else
        {
          return SolutionStat.failed;
        }
      } else
      {
        double p2 = random.NextDouble() * ProjectedLengthSum;
        Vector3d direction2 = IncisionDirection(p2);
        double maxD2 = IncisionLineMaxLength(p2, direction2);
        TessellationTest tt1;
        TessellationTest tt2;
        List<Line> dv;
        if (Intersection2Divide(IncisionLine(p, direction, maxD), IncisionLine(p2, direction2, maxD2), out tt1, out tt2, out dv))
        {
          if (tt1.Solve() == SolutionStat.finished)
          {
            return tt2.Solve();
          }
          else
          {
            return SolutionStat.failed;
          }
        }
      }

      iterations++;
    }
    return SolutionStat.failed;

  }

  public List<Line> PlotsBoundarySegments
  {
    get
    {

      return BoundaryLine.GetSegments().ToList();

    }
  }

  public List<double> ProjectedLengths
  {
    get
    {
      List<double> lengths = new List<double>();
      //Vector3d vec = new Vector3d(LengthProjectionVector);
      foreach (Line line in PlotsBoundarySegments)
      {
        //double angle = Vector3d.VectorAngle(vec, new Vector3d(-line.From + line.To));
        lengths.Add(line.Length * 1.0); // Math.Cos(angle)
      }
      return lengths;
    }
  }

  public double ProjectedLengthSum
  {
    get
    {
      return ProjectedLengths.Sum();
    }
  }

  public List<double> ProjectedLengthsCumulated
  {
    get
    {
      List<double> lengths = new List<double>();
      double sum = 0;
      foreach (double length in ProjectedLengths)
      {
        lengths.Add(length + sum);
        sum = sum + length;
      }
      return lengths;
    }
  }

  public Point3d LengthToPoint(double lengthParameter)
  {
    int index = ProjectedLengthsCumulated.FindIndex(x => x >= lengthParameter);
    double diff = lengthParameter - (ProjectedLengthsCumulated[index] - ProjectedLengths[index]);
    Vector3d direction = PlotsBoundarySegments[index].Direction;
    direction.Unitize();
    return PlotsBoundarySegments[index].From + direction * diff;
  }

  public int LengthToSegment(double lengthParameter)
  {
    return ProjectedLengthsCumulated.FindIndex(x => x >= lengthParameter);
  }

  public Vector3d IncisionDirection(double lengthParameter)
  {
    double avoidAngleDiff = Math.PI / 3.0;
    int index = ProjectedLengthsCumulated.FindIndex(x => x >= lengthParameter);
    double diff = lengthParameter - (ProjectedLengthsCumulated[index] - ProjectedLengths[index]);
    List<double> anglesToAvoid = new List<double>();
    double currentDirection = Trigonometry.Angle(PlotsBoundarySegments[index].From, PlotsBoundarySegments[index].To);
    if (diff <= GlobalSettings.AbsoluteTolerance)
    {
      // point is on the starting end of the segment - the direction of this and the prev segment should be avoided
      anglesToAvoid.Add(currentDirection);
      anglesToAvoid.Add(currentDirection < Math.PI ? currentDirection + Math.PI : currentDirection - Math.PI);
      if (index >= 1)
      {
        var ang = Trigonometry.Angle(PlotsBoundarySegments[index - 1].From, PlotsBoundarySegments[index - 1].To);
        anglesToAvoid.Add(ang);
        anglesToAvoid.Add(ang < Math.PI ? ang + Math.PI : ang - Math.PI);
      }
    }
    else if ((ProjectedLengthsCumulated[index] - lengthParameter) <= GlobalSettings.AbsoluteTolerance)
    {
      anglesToAvoid.Add(currentDirection);
      if (index < PlotsBoundarySegments.Count - 1)
      {
        var ang = Trigonometry.Angle(PlotsBoundarySegments[index + 1].From, PlotsBoundarySegments[index + 1].To);
        anglesToAvoid.Add(ang);
        anglesToAvoid.Add(ang < Math.PI ? ang + Math.PI : ang - Math.PI);
      }
    }

    List<double> pAngles = PrincipleAngles.ToList();
    List<double> pWeights = PrincipleAngles.ToList();

    for (int i = 0; i < pAngles.Count; i++)
    {
      foreach (double angleToAvoid in anglesToAvoid)
      {
        if (Math.Abs(pAngles[i] - angleToAvoid) <= avoidAngleDiff)
        {
          pWeights[i] = 0.0;
        }
      }
    }

    var wrpk = MathsHelper.WeightedRandomPick(pAngles, pWeights);
    double resultAngle = currentDirection;
    while (Trigonometry.OnLeftSideOf(currentDirection, resultAngle) == 1)
    {
      resultAngle = wrpk.Invoke();
    }
    return new Vector3d(Math.Cos(resultAngle), Math.Sin(resultAngle), 0);

  }

  public int OnSegmentId(Point3d pt)
  {
    for (int i = 0; i < PlotsBoundarySegments.Count; i++)
    {
      if (PlotsBoundarySegments[i].DistanceTo(pt, true) < GlobalSettings.AbsoluteTolerance) return i;
    }
    return -1;
  }

  public Line IncisionLine(double lengthParameter, Vector3d direction, double length)
  {
    return new Line(LengthToPoint(lengthParameter), LengthToPoint(lengthParameter) + direction * length);
  }

  public double IncisionLineMaxLength(double lengthParameter, Vector3d direction)
  {
    Line maximumLine = new Line(LengthToPoint(lengthParameter), LengthToPoint(lengthParameter) + direction * 99999);
    List<double> parameters;
    List<int> place;
    if (IntersectComponents(maximumLine, out place, out parameters) >= 2)
    {
      return maximumLine.PointAt(parameters[1]).DistanceTo(maximumLine.From);
    }
    return -1;
  }

  public int IntersectComponents(Line line, out List<int> segsId, out List<double> paramsSorted)
  {
    List<int> intSegs = new List<int>();
    List<double> intParams = new List<double>();

    for (int j = 0; j < PlotsBoundarySegments.Count; j++)
    {
      Line segment = PlotsBoundarySegments[j];
      double a;
      double b;
      bool intersecting = Intersection.LineLine(line, segment, out a, out b, GlobalSettings.AbsoluteTolerance, true);
      if (intersecting)
      {
        intParams.Add(a);
        intSegs.Add(j);
      }
    }

    List<int> segsSorted;
    DataManagement.SortByKeys(intParams, intSegs, out paramsSorted, out segsSorted);
    segsId = segsSorted;
    return intParams.Count;
  }



  public bool Intersection2Divide(Line lineA, Line lineB, out TessellationTest tb1, out TessellationTest tb2, out List<Line> dv)
  {
    tb1 = null;
    tb2 = null;
    dv = null;
    double a;
    double b;
    bool result = Intersection.LineLine(lineA, lineB, out a, out b, GlobalSettings.AbsoluteTolerance, true);
    if (!result)
    {
      return false;
    }
    dv = new List<Line>() { new Line(lineA.From, lineA.PointAt(a)), new Line(lineA.PointAt(a), lineB.From) };
    int fromId = OnSegmentId(BoundaryLine.ClosestPoint(lineA.From));
    int toId = OnSegmentId(BoundaryLine.ClosestPoint(lineB.From));
    List<Point3d> ptsA = new List<Point3d>();
    List<Point3d> ptsB = new List<Point3d>();
    if (fromId > toId)
    {
      int tii = fromId;
      fromId = toId;
      toId = tii;
    }


    for (int i = 0; i < BoundaryLine.Count; i++)
    {
      if (i < fromId)
      {
        ptsA.Add(BoundaryLine[i]);
      }
      else if (i == fromId)
      {
        ptsA.Add(BoundaryLine[i]);
        ptsA.Add(BoundaryLine.ClosestPoint(lineA.From));
        ptsA.Add(lineA.PointAt(a));
        ptsA.Add(BoundaryLine.ClosestPoint(lineB.From));

        ptsB.Add(BoundaryLine.ClosestPoint(lineB.From));
        ptsA.Add(lineA.PointAt(a));
        ptsB.Add(BoundaryLine.ClosestPoint(lineA.From));
      }
      else if (i < toId)
      {
        ptsB.Add(BoundaryLine[i]);
      }
      else if (i == toId)
      {
        ptsB.Add(BoundaryLine[i]);
        ptsB.Add(BoundaryLine.ClosestPoint(lineB.From));
      }
      else
      {
        ptsA.Add(BoundaryLine[i]);
      }
    }

    tb1 = new TessellationTest(new Polyline(ptsA));
    tb2 = new TessellationTest(new Polyline(ptsB));
    return true;
  }

  public void Intersection1Divide(Line line, out TessellationTest tb1, out TessellationTest tb2)
  {
    tb1 = null;
    tb2 = null;

    int fromId = OnSegmentId(BoundaryLine.ClosestPoint(line.From));
    int toId = OnSegmentId(BoundaryLine.ClosestPoint(line.To));
    List<Point3d> ptsA = new List<Point3d>();
    List<Point3d> ptsB = new List<Point3d>();
    if (fromId > toId)
    {
      int tii = fromId;
      fromId = toId;
      toId = tii;
    }


    for (int i = 0; i < BoundaryLine.Count; i++)
    {
      if (i < fromId)
      {
        ptsA.Add(BoundaryLine[i]);
      } else if (i == fromId)
      {
        ptsA.Add(BoundaryLine[i]);
        ptsA.Add(BoundaryLine.ClosestPoint(line.From));
        ptsA.Add(BoundaryLine.ClosestPoint(line.To));

        ptsB.Add(BoundaryLine.ClosestPoint(line.To));
        ptsB.Add(BoundaryLine.ClosestPoint(line.From));
      } else if (i < toId)
      {
        ptsB.Add(BoundaryLine[i]);
      } else if (i == toId)
      {
        ptsB.Add(BoundaryLine[i]);
        ptsB.Add(BoundaryLine.ClosestPoint(line.To));
      } else
      {
        ptsA.Add(BoundaryLine[i]);
      }
    }

    tb1 = new TessellationTest(new Polyline(ptsA));
    tb2 = new TessellationTest(new Polyline(ptsB));
  }

}

public static class GeometryHelper
{
  public static void LinesPrincipleDirections(List<Line> lines, out List<double> Angles, out List<double> Weights)
  {
    // make continuous later (aggregation of probability distribution functions)
    List<double> originalLengths = new List<double>();
    List<double> allLengthsDuplicated = new List<double>();
    lines.ForEach(l => originalLengths.Add(l.From.DistanceTo(l.To) / 4));

    for (int i = 0; i < 4; i++)
    {
      allLengthsDuplicated.AddRange(originalLengths.ToList());
    }

    List<double> originalAngles = new List<double>();
    List<double> allAnglesDuplicated = new List<double>();
    lines.ForEach(l => originalAngles.Add(Trigonometry.Angle(l.From, l.To)));

    allAnglesDuplicated.AddRange(originalAngles.ToList());
    allAnglesDuplicated.AddRange(originalAngles.ConvertAll(x => x >= Math.PI ? x - Math.PI : x + Math.PI)); // + pi
    allAnglesDuplicated.AddRange(originalAngles.ConvertAll(x => x >= Math.PI / 2 ? x - Math.PI / 2 : x + Math.PI * 3 / 2)); // - pi/2
    allAnglesDuplicated.AddRange(originalAngles.ConvertAll(x => x >= Math.PI * 3 / 2 ? x - Math.PI * 3 / 2 : x + Math.PI / 2)); // + pi/2

    List<double> angles = new List<double>();
    List<double> weights = new List<double>();
    double identicalAngleTolerance = 0.1 / 180 * Math.PI;
    double combineAngleTolerance = 15.0 / 180 * Math.PI;
    for(int i = 0; i < allAnglesDuplicated.Count; i++)
    {
      double angle = allAnglesDuplicated[i];
      int index = angles.FindIndex(a => Trigonometry.AngleDifference(angle, a) <= identicalAngleTolerance);
      if (index == -1)
      {
        angles.Add(angle);
        weights.Add(allLengthsDuplicated[i]);
      } else
      {
        weights[index] = weights[index] + allLengthsDuplicated[i];
      }
    }
    int pos = 0;
    while (pos < angles.Count)
    {
      int index = angles.FindIndex(a => pos != angles.IndexOf(a) && Trigonometry.AngleDifference(angles[pos], a) <= combineAngleTolerance);
      if (index == -1)
      {
        pos++;
      } else
      {
        if (weights[pos] >= weights[index])
        {
          weights[pos] = weights[pos] + weights[index];
          weights.RemoveAt(index);
          angles.RemoveAt(index);
          pos++;
        } else
        {
          weights[index] = weights[index] + weights[pos];
          weights.RemoveAt(pos);
          angles.RemoveAt(pos);
        }
      }
    }
    Angles = angles;
    Weights = weights;
  }
}
public static class Trigonometry
{
  /// <summary>
  /// Azimuth angle from source to target. Resultant angle value is between 0 (inclusive) and 2*pi (exclusive)
  /// </summary>
  /// <param name="source">From node</param>
  /// <param name="target">To node</param>
  /// <returns>Azimuth angle from source to target</returns>


  public static double Angle(Point3d ptA, Point3d ptB)
  {
    double angle = Math.Atan2(ptB.Y - ptA.Y, ptB.X - ptA.X);
    if (angle < 0)
    {
      angle = angle + Math.PI * 2;
    }
    return angle;
  }

  /// <summary>
  /// Angle difference between 2 angles
  /// </summary>
  /// <param name="angleA"></param>
  /// <param name="angleB"></param>
  /// <returns>The difference between the two angles in [0, 2*pi)</returns>
  public static double AngleDifference(double angleA, double angleB)
  {
    angleA = angleA % (2 * Math.PI);
    angleB = angleB % (2 * Math.PI);
    double difference = Math.Abs(angleA - angleB);
    return (difference > Math.PI) ? 2 * Math.PI - difference : difference;
  }



  public static double AngleTurned(Point3d ptAA, Point3d ptAB, Point3d ptBA, Point3d ptBB)
  {
    double angleA = Angle(ptAA, ptAB);
    double angleB = Angle(ptBA, ptBB);
    double angleValue = AngleDifference(angleA, angleB);
    return (OnLeftSideOf(angleA, angleB) == 1) ? angleValue : -angleValue;
  }

  public static int OnLeftSideOf(double baseAngle, double angleToCompare)
  {
    baseAngle = baseAngle % (Math.PI * 2);
    angleToCompare = angleToCompare % (Math.PI * 2);
    if (baseAngle == angleToCompare) return 0;
    if (AngleDifference(baseAngle, angleToCompare) == Math.PI) return 0;
    if (baseAngle < Math.PI)
    {
      if (angleToCompare > baseAngle && angleToCompare < baseAngle + Math.PI)
      {
        return 1;
      } else
      {
        return -1;
      }
    } else
    {
      if (angleToCompare < baseAngle && angleToCompare > baseAngle - Math.PI)
      {
        return -1;
      } else
      {
        return 1;
      }
    }
  }
}


public static class GlobalSettings
{
  public static double AbsoluteTolerance = 0.0001;
  public static string SCPrefix = "UDE";
  public static double DefaultOffsetDitance = 4.0;
  public static double DefaultOffsetExtensionDistance = 300;
}
public static class MathsHelper
{
  public static Func<double> WeightedRandomPick(List<double> vals, List<double> weights)
  {
  Random random = new Random();
  double weightSum = weights.Sum();
  List<double> weightsNormalised = weights.ConvertAll(w => w / weightSum);
  List<double> weightsCumSum = new List<double>();
  double sum = 0;
  foreach (double wn in weightsNormalised)
  {
  weightsCumSum.Add(wn + sum);
  sum += wn;
  }
  return () => vals[weightsCumSum.FindIndex(w => w >= random.NextDouble())];

  }


}

public static class DataManagement
{
  public static void SortByKeys(List<double> keys, List<int> items, out List<double> keysSorted, out List<int> itemsSorted)
  {
  //items.Sort((x, y) => keys[items.IndexOf(x)].CompareTo(keys[items.IndexOf(y)]));
  itemsSorted = items.OrderBy(o => keys[items.IndexOf(o)]).ToList();
  //keys.Sort((x, y) => x.CompareTo(y));
  keysSorted = keys.OrderBy(o => o).ToList();
  return;
}
}
# ---------- c_script: C# ----------
    TessellationTest TT = new TessellationTest(x);
# ---------- end c_script ----------
panel = Panel(c_script.out)
